# Grasshopper definition Circle.gh (Grasshopper 1.0.7)

get_number = GetNumber(Slider(4, range=0..10), AtLeast=1, AtMost=1, Maximum=1.797693135e+308, Minimum=-1.797693135e+308, TreeAccess=False)
cir = Circle(Plane=PlaneXY(0, 0, 0), Radius=get_number)

# ---- group: RH_OUT:Circle
geo = Geometry(cir)
